# Grasshopper definition 3DMazeGen.gh (Grasshopper 1.0.7)

display_3d_maze_geometry_slow = BooleanToggle(False)
display_real_time_maze_path = BooleanToggle(True)
maze_size = Slider(3.5, range=1..5)
no_of_rows = Slider(10, range=5..25)
no_of_layers = Slider(10, range=5..25)
no_of_cols = Slider(10, range=5..25)
generate_reset_maze = BooleanToggle(False)
trigger = Trigger(Interval=10, TimerInterval=10, Target=c_script)  # disabled
c_script = CSharpScript(
    width=maze_size,
    rows=no_of_rows,
    cols=no_of_cols,
    layers=no_of_layers,
    generate=generate_reset_maze,
    showMaze=display_3d_maze_geometry_slow,
    showPath=display_real_time_maze_path)  # -> out, maze, marker, mazePath; inputs width: Double, rows: Int32, cols: Int32, layers: Int32, generate: Boolean, showMaze: Boolean, showPath: Boolean
# ---------- c_script: C# ----------
    //False Condition (similar to p5js setup() function)
    //Here we initialize the persistent variables when toggle is false
    if(!generate){
      grid = createGrid(rows, cols, layers, width); //Creating a grid
      current = grid[0]; //setting the current as the first cell in grid
      cellStack = new Stack<Cell>(); //Creating a new stack of cells
      path = new DataTree<Point3d>(); //Creating a new dataTree for path
      pathCount = 0; //initializing the first path to be 0
    } 
    //True Condition (Similar to the p5js draw() function)
    //Here we run the main maze algorithm step, and update persistent variables.
    else {
      //Controlling the display of maze geometry (as it is heavy)
      if(showMaze) {
        //Showing the grid
        List<Brep> gridGeo = new List<Brep>();
        for(int i = 0; i < grid.Count; i++) {
          gridGeo.AddRange(grid[i].show());
        }
        //Sending the maze geometry to the reference variable
        maze = gridGeo;
      }
      //Setting the current cell as visited
      current.visited = true;
      //Showing the cursor at the current cell
      marker = current.highlight();

      //Recursive backtracking algorithm
      //first we get a random unvisited neighbor
      Cell next = current.checkNeighbors(grid);
      //If an unvisited neighbor exists
      if(!(next == null)) {
        next.visited = true; //Make it visited
        cellStack.Push(current); //Add it to our stack
        removeWalls(current, next); //Remove the walls between current and next
        current = next; //And then move on! by setting the current as the next
        //This needs to be added to branch 0 of our path tree
        GH_Path pth = new GH_Path(pathCount);
        path.Add(new Point3d((double) current.i * width, (double) current.j * width, (double) current.k * width), pth);

      } 
      //If an unvisited neighbor doesn't exist, then its a dead end 
      else if(cellStack.Count > 0) {
        current = cellStack.Pop(); //Go back to the previous position
        pathCount++; //update the branch number so that the new path gets added in a new branch

      }
      //If the showPath toggle is on, then send the path to the reference variable
      if(showPath) {
        mazePath = path;
      }

    }
# ---------- c_script: C# additional code ----------
  //Global variables
  /*
  Here we define variables that are to be persistent across every iteration
  of this node that is triggered by the timer component. When a boolean is false,
  we can initialise these variables, and when it is false, we can update the value
  of these variables over time as they are persistent, creating our animation.
  */
  List<Cell> grid; //List of grid cells
  Cell current; //Defines the current cell
  Stack<Cell> cellStack; //This contains the current path stack of the cells
  DataTree<Point3d> path; //This is a tree that stores the path of the cursor in seperate branches.
  //We want this for visualization of the path taken by the cursor.
  int pathCount; //This is the control variable that controls the creation of a new
  //branch if in case the cursor jumps to a new path while generation.

  //this is the class that defines our single cell object
  public class Cell
  {
    public int i, j, k, rows, cols, layers; //the ijk indices, total rows, cols and layers
    public double w, x, y, z; //these are the width and the xyz coordinates of the cell (voxel)
    public bool[] walls = {true, true, true, true, true, true}; //the six walls around the cell
    public bool visited = false; //a flag variable to check if the cell is visited

    //Constructor to initialize the values when an instance of this object is created
    public Cell(int i, int j, int k, double w, int rows, int cols, int layers)
    {
      this.i = i;
      this.j = j;
      this.k = k;
      this.w = w;
      this.rows = rows;
      this.cols = cols;
      this.layers = layers;
    }
    //A function to check for available neighbors and return a random one, if available. else return none.
    public Cell checkNeighbors(List<Cell> grid)
    {
      List<Cell> neighbors = new List<Cell>(); //a temporary list to hold available neighbors
      Cell top, bottom, left, right, up, down;
      //Assigning cardinal directions based on our ij values of the cell
      if(this.j < this.rows - 1) {
        top = grid[this.index(this.i, this.j + 1, this.k)];
      } else {
        top = null;
      }
      if(this.i < this.cols - 1) {
        right = grid[this.index(this.i + 1, this.j, this.k)];
      } else {
        right = null;
      }
      if(this.j > 0) {
        bottom = grid[this.index(this.i, this.j - 1, this.k)];
      } else {
        bottom = null;
      }
      if(this.i > 0) {
        left = grid[this.index(this.i - 1, this.j, this.k)];
      } else {
        left = null;
      }
      if(this.k < this.layers - 1) {
        up = grid[this.index(this.i, this.j, this.k + 1)];
      } else {
        up = null;
      }
      if(this.k > 0) {
        down = grid[this.index(this.i, this.j, this.k - 1)];
      } else {
        down = null;
      }

    //checking which neighbor is unvisited, and adding them to our array if they exist.
      if (!(top == null) && !top.visited) {
        neighbors.Add(top);
      }
      if (!(right == null) && !right.visited) {
        neighbors.Add(right);
      }
      if (!(bottom == null) && !bottom.visited) {
        neighbors.Add(bottom);
      }
      if (!(left == null) && !left.visited) {
        neighbors.Add(left);
      }
      if (!(up == null) && !up.visited) {
        neighbors.Add(up);
      }
      if (!(down == null) && !down.visited) {
        neighbors.Add(down);
      }

    //if there are any neighbors available, then return one at random, else return none.
    //Here, 'null' is used to say none.
      if (neighbors.Count > 0) {
        int index = new Random().Next(neighbors.Count);
        return neighbors[index];
      } else {
        return null;
      }
    }

    //This is a function to highlight the current position of the marker. it draws a box
    //in its position in the size of a cell.
    public Box highlight()
    {
      //Calculating xyz values based on the width and ijk values.
      this.x = (double) this.i * this.w;
      this.y = (double) this.j * this.w;
      this.z = (double) this.k * this.w;
      //We create an interval to the size of the width of the box from its negative half to positive half
      Interval wInterval = new Interval(-this.w / 2.0, this.w / 2.0);
      //Then we create the normal vector in ZAxis direction
      Vector3d normal = new Vector3d(0, 0, 1);
      //Then a plane based on the current xyz position
      Plane p = new Plane(new Point3d(this.x, this.y, this.z), normal);
      //With the above variables, a box is created and returned
      Box highlightBox = new Box(p, wInterval, wInterval, wInterval);
      return highlightBox;
    }

    //This is a helper function to convert 3d indices to a 1d index
    public int index(int i, int j, int k)
    {
      return (k * rows * cols) + (j * cols) + i;
    }

    //This is a function to visualize the walls of this maze
    public List<Brep> show()
    {
      //Getting the xyz coordinates based on ijk positions and width
      this.x = (double) this.i * this.w;
      this.y = (double) this.j * this.w;
      this.z = (double) this.k * this.w;

      //creating an empy list that will collect our wall breps
      List<Brep> wallBrep = new List<Brep>();

      //Here, we simply check if a wall exists, if it exists, add a wall on that side
      if (this.walls[0]) {
        //To add a wall brep, we evaluate the corresponding points based on the xyz values and create a Brep from that
        wallBrep.Add(Brep.CreateFromCornerPoints(
          new Point3d(this.x - (this.w / 2.0), this.y - (this.w / 2.0), this.z + (this.w / 2.0)),
          new Point3d(this.x - (this.w / 2.0), this.y + (this.w / 2.0), this.z + (this.w / 2.0)),
          new Point3d(this.x - (this.w / 2.0), this.y + (this.w / 2.0), this.z - (this.w / 2.0)),
          new Point3d(this.x - (this.w / 2.0), this.y - (this.w / 2.0), this.z - (this.w / 2.0)), 0.01
          ));
      }
      if (this.walls[1]) {
        wallBrep.Add(Brep.CreateFromCornerPoints(
          new Point3d(this.x + (this.w / 2.0), this.y - (this.w / 2.0), this.z + (this.w / 2.0)),
          new Point3d(this.x + (this.w / 2.0), this.y + (this.w / 2.0), this.z + (this.w / 2.0)),
          new Point3d(this.x + (this.w / 2.0), this.y + (this.w / 2.0), this.z - (this.w / 2.0)),
          new Point3d(this.x + (this.w / 2.0), this.y - (this.w / 2.0), this.z - (this.w / 2.0)), 0.01
          ));
      }
      if (this.walls[2]) {
        wallBrep.Add(Brep.CreateFromCornerPoints(
          new Point3d(this.x + (this.w / 2.0), this.y - (this.w / 2.0), this.z + (this.w / 2.0)),
          new Point3d(this.x - (this.w / 2.0), this.y - (this.w / 2.0), this.z + (this.w / 2.0)),
          new Point3d(this.x - (this.w / 2.0), this.y - (this.w / 2.0), this.z - (this.w / 2.0)),
          new Point3d(this.x + (this.w / 2.0), this.y - (this.w / 2.0), this.z - (this.w / 2.0)), 0.01
          ));
      }
      if (this.walls[3]) {
        wallBrep.Add(Brep.CreateFromCornerPoints(
          new Point3d(this.x + (this.w / 2.0), this.y + (this.w / 2.0), this.z + (this.w / 2.0)),
          new Point3d(this.x - (this.w / 2.0), this.y + (this.w / 2.0), this.z + (this.w / 2.0)),
          new Point3d(this.x - (this.w / 2.0), this.y + (this.w / 2.0), this.z - (this.w / 2.0)),
          new Point3d(this.x + (this.w / 2.0), this.y + (this.w / 2.0), this.z - (this.w / 2.0)), 0.01
          ));
      }
      if (this.walls[4]) {
        wallBrep.Add(Brep.CreateFromCornerPoints(
          new Point3d(this.x - (this.w / 2.0), this.y - (this.w / 2.0), this.z + (this.w / 2.0)),
          new Point3d(this.x - (this.w / 2.0), this.y + (this.w / 2.0), this.z + (this.w / 2.0)),
          new Point3d(this.x + (this.w / 2.0), this.y + (this.w / 2.0), this.z + (this.w / 2.0)),
          new Point3d(this.x + (this.w / 2.0), this.y - (this.w / 2.0), this.z + (this.w / 2.0)), 0.01
          ));
      }
      if (this.walls[5]) {
        wallBrep.Add(Brep.CreateFromCornerPoints(
          new Point3d(this.x - (this.w / 2.0), this.y - (this.w / 2.0), this.z - (this.w / 2.0)),
          new Point3d(this.x - (this.w / 2.0), this.y + (this.w / 2.0), this.z - (this.w / 2.0)),
          new Point3d(this.x + (this.w / 2.0), this.y + (this.w / 2.0), this.z - (this.w / 2.0)),
          new Point3d(this.x + (this.w / 2.0), this.y - (this.w / 2.0), this.z - (this.w / 2.0)), 0.01
          ));
      }

      //If there are walls, then return the list
        if(wallBrep.Count > 0) {
        return wallBrep;
      }
      //If there is no wall, then return null (nothing)
      return null;
    }
  }

  //Function that removes the wall between two input cells
  public void removeWalls(Cell a, Cell b)
  {
    //First we calculate the difference in the col index
    int x = a.i - b.i;

    //If it is 1, then a is to the right of b, so we remove the associated walls of both
    if (x == 1) {
      a.walls[0] = false;
      b.walls[1] = false;
    }
    //If it is -1, then a is to the left of b, so we remove the corresponding walls of a and b.
    else if (x == -1) {
      a.walls[1] = false;
      b.walls[0] = false;
    }
    //Then we repeat the same process for the row index and layer index
    //and we remove the corresponding walls of a and b based on their relative positions on that axis


    int y = a.j - b.j;

    if (y == 1) {
      a.walls[2] = false;
      b.walls[3] = false;
    } else if (y == -1) {
      a.walls[3] = false;
      b.walls[2] = false;
    }

    int z = a.k - b.k;

    if (z == 1) {
      a.walls[5] = false;
      b.walls[4] = false;
    } else if (z == -1) {
      a.walls[4] = false;
      b.walls[5] = false;
    }
  }

  //This is a function to create a grid of cells based on input grid parameters
  public List<Cell> createGrid(int rows, int cols, int layers, double width)
  {
    List<Cell> grid = new List<Cell>();
    //Creating grid of cells
    for(int k = 0; k < layers; k++) {
      for(int j = 0; j < rows; j++) {
        for(int i = 0; i < cols; i++) {
          //We create an instance of our cell object, and add it to our grid
          Cell node = new Cell(i, j, k, width, rows, cols, layers);
          grid.Add(node);
        }
      }
    }
    return grid;
  }
# ---------- end c_script ----------
preview = CustomPreview(Geometry=c_script.maze, Material=ColourSwatch(SwatchColor=RGBA(128, 128, 128, 10)))
preview_2 = CustomPreview(Geometry=c_script.marker, Material=ColourSwatch(SwatchColor=RGB(111, 212, 229)))
cullpt = CullDuplicates(Points=c_script.mazePath, Tolerance=0.1, CullMode=3)  # -> Points, Indices, Valence
prune = PruneTree(Tree=cullpt.Points, Minimum=2, Maximum=0)
pline = PolyLine(Vertices=prune, Closed=False)
preview_3 = CustomPreview(Geometry=pline, Material=ColourSwatch(SwatchColor=RGB(230, 221, 69)))
